# Requirement set f16a_logical_derived (R2026a)
Design-decision requirements for the F-16A, produced by the Logical-layer (RFLP L) trade studies. Each records which solution option was selected to realize a role, and why. Kept separate from the sizing-derived set (f16a.slreqx) and the functional-derived set (f16a_functional_derived.slreqx).

## 1 [REQ_F16A_LOGICAL] F-16A logical design decisions (Container)
Root container for design-decision requirements produced at the Logical layer. Each captures the selected option for a role that had multiple credible alternatives, with the trade-study rationale.
Keywords: draft, derived, logical, decision

### 1.1 [REQ_F16A_L01] Propulsion: single-engine selection
The PropulsionSystem role shall be realized by a single afterburning turbofan (Pratt & Whitney F100 class), rather than a twin-engine installation. This is the production F-16A configuration and the outcome of the Lightweight Fighter (YF-16 vs YF-17) trade.
Rationale: Logical-layer trade study (F16ALogicalTradeStudy): the single-engine option wins the weighted score by dominating on unit cost, installed weight, and technology readiness, accepting lower engine-out survivability than the twin-engine alternative. The alternative (TwinEngine_LWF) is retained in the model as the traded option.
Keywords: draft, derived, logical, decision

### 1.2 [REQ_F16A_L02] Flight control: analog fly-by-wire selection
The FlightControlSystem role shall be realized by a (quad-redundant) analog fly-by-wire system enabling relaxed static stability, rather than a conventional hydro-mechanical control system. The F-16A was the first production fighter to fly a fly-by-wire flight control system.
Rationale: Logical-layer trade study (F16ALogicalTradeStudy): the fly-by-wire option wins the weighted score on maneuver/agility benefit (it unlocks relaxed static stability and the associated turn performance) and control-system weight, outweighing its lower technology readiness and higher cost relative to the hydro-mechanical alternative. The alternative (HydroMechanical) is retained in the model as the traded option.
Keywords: draft, derived, logical, decision

### 1.3 [REQ_F16A_L03] Airframe: blended cranked-delta wing selection
The Airframe role shall be realized by a cropped/cranked-delta blended wing-body with leading-edge root extensions (LERX), rather than a conventional trapezoidal wing on a discrete fuselage. This is the production F-16A configuration.
Rationale: Logical-layer trade study (F16ALogicalTradeStudy): the blended cranked-delta option wins the weighted score on high-alpha / sustained-turn benefit and structural efficiency (lower structural weight fraction), outweighing its lower technology readiness and higher aero-development cost relative to the conventional-wing alternative. The alternative (ConventionalTrapWing) is retained in the model as the traded option.
Keywords: draft, derived, logical, decision