# Requirement set f16a_physical_derived (R2026a)
Requirements owned and verified at the Physical layer (RFLP P) of the F-16A model. Kept separate from the sizing-derived set (f16a.slreqx), the functional-derived set, and the logical-derived set.

## 1 [REQ_F16A_PHYSICAL] F-16A physical-layer requirements (Container)
Root container for requirements surfaced and verified at the Physical layer, where concrete parts and roll-up analyses exist to measure them.
Keywords: draft, derived, physical

### 1.1 [REQ_F16A_P01] Fuel volume sufficiency
The aircraft shall provide sufficient internal fuel tankage (volume, expressed as fuel-weight capacity) to carry the fuel required to complete the design mission profile (REQ_F16A_001-010), without reliance on external tanks. Verification method: the total available fuel capacity (a roll-up over the internal fuel tanks) shall be greater than or equal to the mission fuel required (from mission analysis).
Rationale: Range/endurance closure depends on carrying enough fuel. This is verified at the Physical layer because it needs concrete tanks (to roll up available capacity) and a mission-fuel estimate to compare against. The mission-fuel estimate is currently a stub (NaN) pending connection to the sizing mission analysis in /sizing/, so verification is intentionally pending (the verify test fails until the analysis is wired in).
Keywords: draft, derived, physical, verify, todo