% Requirement links of F16AStaticMarginVerificationTest.m (R2026a)

% lines 90-105 verifies f16a.slreqx#33
        function testTakeoffStaticMarginWithinBand(testCase)
            % The AFT end of the CG range -- heaviest, full fuel, full stores.
            % Stores and fuel sit aft of the CG, so using them moves it forward.
            testCase.verifyThat(testCase.Balance.SM_TO, ...
                testCase.inBandConstraint(), ...
                testCase.bandMessage("takeoff", testCase.Balance.SM_TO));
        end

        function testLandingStaticMarginWithinBand(testCase)
            % The FORWARD end: fuel burnt, stores released. "Across the
            % operational CG range" means both ends must hold -- checking only
            % takeoff verifies half a requirement (D-047 guarantee 4).
            testCase.verifyThat(testCase.Balance.SM_land, ...
                testCase.inBandConstraint(), ...
                testCase.bandMessage("landing", testCase.Balance.SM_land));
        end